# Grasshopper definition PathCreation.gh (Grasshopper 1.0.7)
# plug-ins: Human, PathCreation

crv = Curve(reparameterize(<curve referenced from the Rhino model>))
crv_2 = Curve(reparameterize(<curve referenced from the Rhino model>))
crv_3 = Curve(reparameterize(crv_2))
scalebox = ScaleBox(num=Slider(3, range=0..100), R=crv_3)
eval = EvaluateCurve(Curve=crv_3, Parameter=Slider(0.7, range=0..1))  # -> Point, Tangent, Angle
number_slider = Slider(3.3, range=0..10)
crv_4 = Curve(reparameterize(crv))
num = Number(number_slider)
crv_5 = Curve(reparameterize(<curve referenced from the Rhino model>))
subtraction = Subtraction(A=num, B=Slider(0, range=0..10))
addition = Addition(A=num, B=Slider(5, range=0..10))
scalebox_2 = ScaleBox(num=Slider(5, range=0..100), R=crv_4)
eval_2 = EvaluateCurve(Curve=crv_4, Parameter=Slider(0.1, range=0..1))  # -> Point, Tangent, Angle
crv_6 = Curve(<curve referenced from the Rhino model>)
neg = Negative(Value=Slider(0.8, range=0..1))
crv_7 = Curve(scalebox_2)
offset = OffsetCurve(Curve=crv_5, Distance=expr("-x", addition), Corners=1)
eval_3 = EvaluateCurve(Curve=crv_5, Parameter=Slider(0.58, range=0..1))  # -> Point, Tangent, Angle
offset_2 = OffsetCurve(Curve=crv_5, Distance=addition, Corners=1)
scalebox_3 = ScaleBox(num=Slider(2, range=0..100), R=crv_6)
scalebox_4 = ScaleBox(num=neg, R=crv_7)
entwine = Entwine(Branch00=offset_2, Branch01=offset, FlattenInputs=True)  # -> flatten(Result)
cir = Circle(Plane=[eval_3.Point, eval_2.Point], Radius=Slider(5, range=0..10))
dash = DashPattern(Curve=cir, Pattern="1")  # -> Dashes, Gaps
crv_8 = Curve([scalebox_4, scalebox_3])
crvprox = CurveProximity(CurveA=crv_4, CurveB=entwine)  # -> PointA, PointB, Distance
crv_cp = CurveClosestPoint(Point=eval_2.Point, Curve=scalebox_2)  # -> Point, Parameter, Distance
sort = SortList(Keys=crvprox.Distance, ValuesA=entwine)  # -> Keys, ValuesA
previewlw = CustomPreviewLineweights(Geometry=dash.Dashes, Shader=ColourSwatch(SwatchColor=RGB(255, 55, 0)), Thickness=Slider(2, range=0..10), Absolute=False)
item = ListItem(List=sort.ValuesA, Index=0, Wrap=True)
crv_cp_2 = CurveClosestPoint(Point=eval_3.Point, Curve=item)  # -> Point, Parameter, Distance
pc = PathCreation(
    StartPoint=crv_cp.Point,
    EndPoint=crv_cp_2.Point,
    Obstacle=crv_8,
    Resolution=Slider(30, range=0..100),
    Orthogonal=Toggle(True))  # -> OutputPath, PathGrid
explode = Explode(Curve=pc.OutputPath, Recursive=True)  # -> Segments, Vertices
join = JoinCurves(Curves=explode.Segments, Preserve=False)
disc = Discontinuity(Curve=join, Level=1)  # -> Points, Parameters
rev = ReverseList(List=disc.Points)
ins = InsertItems(List=rev, Item=eval_2.Point, Indices=Slider(0, range=0..100), Wrap=True)
ins_2 = InsertItems(List=ins, Item=eval_3.Point, Indices="-1", Wrap=True)
pline = PolyLine(Vertices=ins_2, Closed=False)
crv_9 = Curve([<curve referenced from the Rhino model> x2])
crv_10 = Curve(<curve referenced from the Rhino model>)
crv_11 = Curve([<curve referenced from the Rhino model> x6])
crv_12 = Curve(<curve referenced from the Rhino model>)
道路生成 = 道路生成(
    外侧道路宽度=Slider(7, range=0..10),
    crv=crv_10,
    unit=Slider(1, range=0..1),
    轴线指定宽度=number_slider,
    连接道路宽度=Slider(1.7, range=0..10),
    指定轴线=crv_9,
    连接道路=[pline, crv_12],
    楼栋平面=crv_11)
道路 = Surface(道路生成)
preview = CustomPreview(Geometry=道路, Material=ColourSwatch(SwatchColor=RGB(105, 105, 105)))

# ==== cluster ScaleBox
num = ClusterInput()
R = ClusterInput()
num_2 = Number(num)
drec = DeconstuctRectangle(Rectangle=R)  # -> BasePlane, XInterval, YInterval
dedomain = DeconstructDomain(Domain=drec.XInterval)  # -> Start, End
dedomain_2 = DeconstructDomain(Domain=drec.YInterval)  # -> Start, End
subtraction = Subtraction(A=dedomain.Start, B=num_2)
addition = Addition(A=dedomain.End, B=num_2)
subtraction_2 = Subtraction(A=dedomain_2.Start, B=num_2)
addition_2 = Addition(A=dedomain_2.End, B=num_2)
dom = ConstructDomain(DomainStart=subtraction, DomainEnd=addition)
dom_2 = ConstructDomain(DomainStart=subtraction_2, DomainEnd=addition_2)
rectangle = Rectangle(Plane=drec.BasePlane, XSize=dom, YSize=dom_2, Radius=0)  # -> Rectangle, Length
R_2 = ClusterOutput(rectangle.Rectangle)

# ==== cluster 道路生成
unit = ClusterInput()
外侧道路宽度 = ClusterInput()
unit_2 = Number(unit)
combine = CombineData(Input0=外侧道路宽度, Input1=Slider(8, range=0..10))  # -> Result, Index
crv = ClusterInput()
multiplication = Multiplication(外围道路宽度=combine.Result, B=unit_2)
multiplication_2 = Multiplication(道路倒角半径=Slider(10, range=0..10), B=unit_2)
crv_2 = Curve(crv)
连接道路宽度 = ClusterInput()
轴线指定宽度 = ClusterInput()
指定轴线 = ClusterInput()
连接道路 = ClusterInput()
offset = OffsetCurve(Curve=crv_2, Distance=expr("-x", multiplication), Corners=1)
轴线分割 = 轴线分割(_0=轴线指定宽度, 连接道路宽度=连接道路宽度, 轴线控制比例=Slider(0.4, range=0..1), E=offset, crv=指定轴线)
crv_3 = Curve(连接道路)
ext = ExtendCurve(Curve=crv_3, Type=0, Start=Slider(0.5, range=0..1), End=Slider(0, range=0..100))
楼栋平面 = ClusterInput()
crv_4 = Curve(楼栋平面)
splitatcorners = SplitAtCorners(Poly=轴线分割, Angle=Slider(0.4, range=0..1))  # -> Corners, Parts
graft = GraftTree(Tree=crv_4, IncludeEmptyLists=True, IncludeNullItems=True)
ccx = CurveCurve(CurveA=连接道路, CurveB=graft)  # -> Points, ParamsA, ParamsB
lng = ListLength(List=ccx.ParamsB)
pline = PolyLine(Vertices=splitatcorners.Corners, Closed=invert(False))
equals = Equality(FirstNumber=lng, SecondNumber=0)  # -> Equality, Inequality
dispatch = Dispatch(List=graft, DispatchPattern=equals.Inequality)  # -> ListA, ListB
fillet = Fillet(Curve=pline, Radius=multiplication_2)
entwine = Entwine(Branch00=crv_2, Branch01=fillet, FlattenInputs=True)
offset_2 = OffsetCurve(Curve=ext, Distance=expr("-x", 连接道路宽度), Corners=1)
offset_3 = OffsetCurve(Curve=ext, Distance=连接道路宽度, Corners=1)
Z = UnitZ(Factor=1)
Z_2 = UnitZ(Factor=1)
boundary = BoundarySurfaces(Edges=fillet)
flatten = FlattenTree(Tree=dispatch.ListA, Path="{0}")
boundary_2 = BoundarySurfaces(Edges=flatten)
multiplication_3 = Multiplication(A=Z_2, B=-2)
loft = Loft(
    Curves=[offset_3, offset_2],
    Options={Adjust=False, Closed=False, LoftEnds=0, LoftSimp=0, LoftType=0, Rebuild=10, Refit=0.01})
multiplication_4 = Multiplication(A=Z, B=-2)
entwine_2 = Entwine(Branch00=loft, Branch01=boundary_2, FlattenInputs=True)  # -> flatten(Result)
move = Move(Geometry=boundary_2, Motion=Z)  # -> Geometry, Transform
move_2 = Move(Geometry=entwine_2, Motion=Z)  # -> Geometry, Transform
extr = Extrude(Base=move.Geometry, Direction=multiplication_4)
extr_2 = Extrude(Base=move_2.Geometry, Direction=multiplication_4)
boundary_3 = BoundarySurfaces(Edges=crv_2)
flatten_2 = FlattenTree(Tree=boundary, Path="{0}")
trim = TrimSolid(Shape=flatten_2, Cutters=flatten(extr_2))
edges = BrepEdges(Brep=trim)  # -> Naked, Interior, NonManifold
join = JoinCurves(Curves=edges.Naked, Preserve=False)
divlength = DivideLength(Curve=join, Length=Slider(1.8, range=0..10))  # -> Points, Tangents, Parameters
pline_2 = PolyLine(Vertices=divlength.Points, Closed=False)
splitatcorners_2 = SplitAtCorners(Poly=pline_2, Angle=Slider(0.09, range=0..1))  # -> Corners, Parts
panel = Panel(trim)
pline_3 = PolyLine(Vertices=splitatcorners_2.Corners, Closed=invert(False))
fillet_2 = Fillet(Curve=pline_3, Radius=Slider(1, range=0..10))
boundary_4 = BoundarySurfaces(Edges=fillet_2)
move_3 = Move(Geometry=boundary_4, Motion=Z_2)  # -> Geometry, Transform
extr_3 = Extrude(Base=move_3.Geometry, Direction=multiplication_3)
flatten_3 = FlattenTree(Tree=extr_3, Path="{0}")
trim_2 = TrimSolid(Shape=boundary_3, Cutters=flatten_3)  # disabled
boundary_5 = BoundarySurfaces(Edges=flatten([crv_2, fillet_2]))
trim_3 = TrimSolid(Shape=boundary_5, Cutters=extr)
R = ClusterOutput(trim_3)

# ==== cluster 轴线分割: 沿轴线将场地进行初步分割; 可以分别调整y轴正负方向的偏移量
crv = ClusterInput()
E = ClusterInput()
crv_2 = Curve(crv)
graft = GraftTree(Tree=crv_2, IncludeEmptyLists=True, IncludeNullItems=True)
item = ListItem(List=graft, Index=0, Wrap=True)

# ---- group: 判定是否更趋向于x轴
end = EndPoints(Curve=graft)  # -> Start, End
vec2pt = Vector2Pt(PointA=end.Start, PointB=end.End, Unitize=False)  # -> Vector, Length
X = UnitX(Factor=1)
rev = Reverse(Vector=X)
angle = Angle(VectorA=vec2pt.Vector, VectorB=rev)  # -> Angle, Reflex
angle_2 = Angle(VectorA=vec2pt.Vector, VectorB=X)  # -> Angle, Reflex
pi = Pi(Factor=Slider(0.25, range=0..1))
smaller = SmallerThan(FirstNumber=angle_2.Angle, SecondNumber=pi)  # -> SmallerThan, OrEqualTo
smaller_2 = SmallerThan(FirstNumber=angle.Angle, SecondNumber=pi)  # -> SmallerThan, OrEqualTo
or = GateOr(A=smaller.SmallerThan, B=smaller_2.SmallerThan)

# ---- group: 确定x，y轴的避让距离
bbox = BoundingBox(Content=E, Plane=PlaneXY(0, 0, 0))  # -> Box, Box_2
底面边界 = 底面边界(B=bbox.Box, G=0)
cluster = Cluster(C=底面边界, axis="x")
cluster_2 = Cluster(C=底面边界, axis="y")
number_slider = Slider(5, range=0..10)
division = Division(A=cluster, B=number_slider)
division_2 = Division(A=cluster_2, B=number_slider)
X_2 = UnitX(Factor=1)
Y = UnitY(Factor=1)
contour = Contour(Shape=E, Point=Point(0, 0, 0), Direction=X_2, Distance=division)
contour_2 = Contour(Shape=E, Point=Point(0, 0, 0), Direction=Y, Distance=division_2)
len = Length(Curve=contour)  # -> flatten(Length)
len_2 = Length(Curve=contour_2)  # -> flatten(Length)
number_slider_2 = Slider(15, range=0..100)
avr = Average(Input=len)
avr_2 = Average(Input=len_2)
division_3 = Division(A=avr, B=number_slider_2)
division_4 = Division(A=avr_2, B=number_slider_2)

# ----
dispatch = Dispatch(List=graft, DispatchPattern=or)  # -> ListA, ListB
boundary = BoundarySurfaces(Edges=E)
轴线控制比例 = ClusterInput()  # 用于控制道路与实际排布地块，最高为1，用于道路时适当降低
y轴方向避让距离 = Number(division_3)
x轴方向避让距离 = Number(division_4)
_0 = ClusterInput()
multiplication = Multiplication(A=轴线控制比例, B=x轴方向避让距离)
multiplication_2 = Multiplication(A=轴线控制比例, B=y轴方向避让距离)
combine = CombineData(Input0=_0, Input1=multiplication_2)  # -> Result, Index
combine_2 = CombineData(Input0=_0, Input1=multiplication)  # -> Result, Index
num = Number(combine_2.Result)
num_2 = Number(combine.Result)

# ---- group: 判断线段偏移正负方向，y轴负方向会偏移更多
midpt = CurveMiddle(Curve=dispatch.ListA)
crv_cp = CurveClosestPoint(Point=midpt, Curve=dispatch.ListA)  # -> Point, Parameter, Distance
hframe = HorizontalFrame(Curve=dispatch.ListA, Parameter=crv_cp.Parameter)
deplane = DeconstructPlane(Plane=hframe)  # -> Origin, XAxis, YAxis, ZAxis
c_script = CSharpScript(Vec=deplane.YAxis)  # -> yPositive, yNegative; inputs Vec: Vector3d
# ---------- c_script: C# ----------
    Vector3d yVec = new Vector3d(0, 1, 0);
    if(Vec * yVec > 0)
    {
      yPositive = Vec;
      yNegative = -Vec;
    }
    if(Vec * yVec < 0)
    {
      yPositive = -Vec;
      yNegative = Vec;
    }
# ---------- end c_script ----------
pl = ConstructPlane(Origin=deplane.Origin, XAxis=deplane.XAxis, YAxis=c_script.yNegative)
pl_2 = ConstructPlane(Origin=deplane.Origin, XAxis=deplane.XAxis, YAxis=c_script.yPositive)
multiplication_3 = Multiplication(A=Slider(1, range=0..10), B=num_2)
offset = OffsetCurve(Curve=dispatch.ListA, Distance=num_2, Plane=pl, Corners=1)
offset_2 = OffsetCurve(Curve=dispatch.ListA, Distance=multiplication_3, Plane=pl_2, Corners=1)

# ----
offset_3 = OffsetCurve(Curve=dispatch.ListB, Distance=expr("-x", num), Corners=1)
offset_4 = OffsetCurve(Curve=dispatch.ListB, Distance=num, Corners=1)
simplify = SimplifyTree(Tree=offset, Front=False)
simplify_2 = SimplifyTree(Tree=offset_2, Front=False)
连接道路宽度 = ClusterInput()
simplify_3 = SimplifyTree(Tree=offset_4, Front=False)
simplify_4 = SimplifyTree(Tree=offset_3, Front=False)
连接道路 = ClusterInput()
combine_3 = CombineData(Input0=连接道路宽度, Input1=Slider(1.5, range=0..10))  # -> Result, Index
merge = Merge(Data1=simplify_3, Data2=simplify_4, Data3=simplify, Data4=simplify_2)
clean = CleanTree(RemoveNulls=True, RemoveInvalid=True, RemoveEmpty=False, Tree=merge)
offset_5 = OffsetCurve(Curve=连接道路, Distance=expr("-x", combine_3.Result), Corners=1)
offset_6 = OffsetCurve(Curve=连接道路, Distance=combine_3.Result, Corners=1)
Z = UnitZ(Factor=1)
loft = Loft(Curves=clean, Options={Adjust=False, Closed=False, LoftEnds=0, LoftSimp=0, LoftType=0, Rebuild=10, Refit=0.01})
merge_2 = Merge(Data1=offset_6, Data2=offset_5)
panel = Panel(clean)
multiplication_4 = Multiplication(A=Z, B="-2")
loft_2 = Loft(Curves=merge_2, Options={Adjust=False, Closed=False, LoftEnds=0, LoftSimp=0, LoftType=0, Rebuild=10, Refit=0.01})
entwine = Entwine(Branch00=loft_2, Branch01=loft, FlattenInputs=True)
move = Move(Geometry=entwine, Motion=Z)  # -> Geometry, Transform
extr = Extrude(Base=move.Geometry, Direction=multiplication_4)
flatten = FlattenTree(Tree=extr, Path="{0}")
clean_2 = CleanTree(RemoveNulls=True, RemoveInvalid=True, RemoveEmpty=False, Tree=flatten)
trim = TrimSolid(Shape=boundary, Cutters=clean_2)
edges = BrepEdges(Brep=trim)  # -> Naked, Interior, NonManifold
join = JoinCurves(Curves=edges.Naked, Preserve=False)
simplify_5 = SimplifyTree(Tree=join, Front=False)
T = ClusterOutput(simplify_5)

# ==== cluster Cluster: 指定轴线方向矩形长度
C = ClusterInput()
axis = ClusterInput()
explode = Explode(Curve=C, Recursive=True)  # -> Segments, Vertices
c_script = CSharpScript(axis=axis)  # -> A; inputs axis: String
# ---------- c_script: C# ----------
    if(axis == "x" || axis == "X") A = 0;
    if(axis == "y" || axis == "Y") A = 1;
    if(axis == "z" || axis == "Z") A = 2;
# ---------- end c_script ----------
midpt = CurveMiddle(Curve=explode.Segments)
pdecon = Deconstruct(Point=midpt)  # -> XComponent, YComponent, ZComponent
filter = StreamFilter(Gate=c_script, Stream0=pdecon.XComponent, Stream1=pdecon.YComponent, Stream2=pdecon.ZComponent)
item = ListItem(List=filter, Index=0, Wrap=True)  # -> Item, Item1, Item2, Item3
subtraction = Subtraction(A=item.Item, B=item.Item2)
subtraction_2 = Subtraction(A=item.Item1, B=item.Item3)
abs = Absolute(Value=subtraction)
abs_2 = Absolute(Value=subtraction_2)
c_script_2 = CSharpScript(x=abs, y=abs_2)  # -> A; inputs x: Double, y: Double
# ---------- c_script_2: C# ----------
    if(x > y) A = x;
    else A = y;
# ---------- end c_script_2 ----------
length = ClusterOutput(c_script_2)

# ==== cluster 底面边界: 获取物体上下面边界曲线Polyline； G为0时取底面边界； G为1时取顶面边界；
B = ClusterInput()
debrep = DeconstructBrep(Brep=B)  # -> Faces, Edges, Vertices
pcen = PolygonCenter(Polyline=debrep.Faces)  # -> CenterV, CenterE, CenterA
pdecon = Deconstruct(Point=pcen.CenterV)  # -> XComponent, YComponent, ZComponent
sort = SortList(Keys=pdecon.ZComponent, ValuesA=debrep.Faces)  # -> Keys, ValuesA
item = ListItem(List=reverse(sort.ValuesA), Index=0, Wrap=True)
item_2 = ListItem(List=sort.ValuesA, Index=0, Wrap=True)
G = ClusterInput()
filter = StreamFilter(Gate=G, Stream0=item_2, Stream1=item)
edges = BrepEdges(Brep=filter)  # -> Naked, Interior, NonManifold
join = JoinCurves(Curves=edges.Naked, Preserve=False)
trim = TrimTree(Tree=join, Depth=Slider(3, range=0..10))
T = ClusterOutput(trim)
